% Simulink data dictionary ModelDictionary.sldd

EtherCATReceivedFromBMS = Simulink.Bus()
  stateBMS: double
  statusChargeBattery: double
  statusTemperatureBattery: double
  minVoltCell: double
  maxVoltCell: double

EtherCATReceivedFromPowerElectronics = Simulink.Bus()
  receivedFromPDB: Bus: EtherCATReceivedFromPDB
  receivedFromBMS: Bus: EtherCATReceivedFromBMS

EtherCATSendToPowerElectronics = Simulink.Bus()
  sendToPDB: Bus: EtherCATSendToPDB

GaitGeneratorInput = Simulink.Bus()
  targetLeg: Enum: Leg
  stepType: Enum: StepType

JointDynamics = Simulink.Bus()
  angle: double
  velocity: double
  torque: double

PowerElectronicsError = Simulink.Bus()
  errorPDB: double
  errorBMS: double

JointControlConfigLKFE_Param = Simulink.Parameter(struct(
  angleOffset=1245,
  polePairs=21,
  minPosLimit=-200,
  maxPosLimit=200,
  maxSpeed=60,
  maxTorque=2.122,
  positionKp=500000,
  positionKi=0,
  positionKd=0,
  positionIntegralLimit=2122,
  velocityKp=600000,
  velocityKi=10000,
  velocityKd=0,
  velocityIntegralLimit=2122,
  brakeReleaseStrategy=0), DataType="Bus: JointControlConfig")

JointControlConfigRHFE_Param = Simulink.Parameter(struct(
  angleOffset=1245,
  polePairs=21,
  minPosLimit=-200,
  maxPosLimit=200,
  maxSpeed=60,
  maxTorque=2.122,
  positionKp=500000,
  positionKi=0,
  positionKd=0,
  positionIntegralLimit=2122,
  velocityKp=600000,
  velocityKi=10000,
  velocityKd=0,
  velocityIntegralLimit=2122,
  brakeReleaseStrategy=0), DataType="Bus: JointControlConfig")

JointControlConfigRKFE_Param = Simulink.Parameter(struct(
  angleOffset=1245,
  polePairs=21,
  minPosLimit=-200,
  maxPosLimit=200,
  maxSpeed=60,
  maxTorque=2.122,
  positionKp=500000,
  positionKi=0,
  positionKd=0,
  positionIntegralLimit=2122,
  velocityKp=600000,
  velocityKi=10000,
  velocityKd=0,
  velocityIntegralLimit=2122,
  brakeReleaseStrategy=0), DataType="Bus: JointControlConfig")

EtherCATReceivedFromGESJoint = Simulink.Bus()
  temperature: double

JointDynamicCommand = Simulink.Bus()
  jointDynamics: Bus: JointDynamics
  jointCommand: Enum: JointCommand

EtherCATReceivedFromSOMANET = Simulink.Bus()
  statusword: double
  actualAngle: double
  actualVelocity: double
  actualTorque: double
  userMISO: double
  tuningStatus: double
  errorSOMANET: double
  statusPhaseCurrentB: double
  statusPhaseCurrentC: double
  opMode: double
  statusTemperature: double
  timestamp: double
  actualMotorAngle: double
  actualMotorVelocity: double

resolutionMotorEncoder = Simulink.Parameter(4096)

EtherCATReceivedFromGESBack = Simulink.Bus()
  temperatureRHFE: double
  temperatureLHFE: double

GESErrors = Simulink.Bus()
  errorGESLKFE: Enum: GESError
  errorGESRKFE: Enum: GESError
  errorGESBack: Enum: GESError

GaitPhases = Simulink.Bus()
  phaseRightLeg: double
  phaseLeftLeg: double

motorResistance = Simulink.Parameter(0.2)  % Motor Resistance in Ohms. See https://confluence.projectmarch.nl:8443/display/05TECH/Instantaneous+phase+current+to+power+supply+current
backEMFConstant = Simulink.Parameter(131.2)  % BackEMF Constant, in RPM/V. See https://confluence.projectmarch.nl:8443/display/05TECH/Instantaneous+phase+current+to+power+supply+current

EtherCATSendToSOMANET = Simulink.Bus()
  tuningCommand: double
  userMOSI: double
  targetAngle: double
  targetVelocity: double
  targetTorque: double
  controlword: Enum: SomanetControlWord
  opMode: Enum: SomanetOpmode
  maxTorque: double

MiscDataSOMANET = Simulink.Bus()
  jointControlConfigs: Bus: JointControlConfig[1 4]
  somanetData: Bus: SOMANETData[1 4]

SOMANETData = Simulink.Bus()
  somanetState: Enum: SomanetState
  controlState: Enum: SomanetControlState
  opMode: Enum: SomanetOpmode
  somanetError: Enum: SomanetError
  positionKp: double
  positionKi: double
  positionKd: double
  phaseAmplitude: double
  electricPower: double
  surfaceI2t: double

maxHomeAcceleration = 1
maxHomeVelocity = 0.4
resolutionJointEncoder = Simulink.Parameter(65536, DataType="double")
maxTemperature = Simulink.Parameter(120, Unit="degree_Celsius")
maxTemperatureJoint = Simulink.Parameter(100, Unit="degree_Celsius")
maxNonResponsive = Simulink.Parameter(0.3, Unit="second")
gaitFrequency = 500

JointControlConfig = Simulink.Bus()
  angleOffset: double
  polePairs: double
  minPosLimit: double
  maxPosLimit: double
  maxSpeed: double
  maxTorque: double
  positionKp: double
  positionKi: double
  positionKd: double
  positionIntegralLimit: double
  velocityKp: double
  velocityKi: double
  velocityKd: double
  velocityIntegralLimit: double
  softStopThreshold: double

JointControlConfigLHFE_Param = Simulink.Parameter(struct(
  angleOffset=1245,
  polePairs=21,
  minPosLimit=-5,
  maxPosLimit=115,
  maxSpeed=60,
  maxTorque=2.122,
  positionKp=500000,
  positionKi=0,
  positionKd=0,
  positionIntegralLimit=2122,
  velocityKp=600000,
  velocityKi=10000,
  velocityKd=0,
  velocityIntegralLimit=2122,
  brakeReleaseStrategy=0), DataType="Bus: JointControlConfig")

somanetSyncMode = Simulink.Parameter(2)
zeroOffsetLKFE = Simulink.Parameter(174.676, Unit="degree")
zeroOffsetLHFE = Simulink.Parameter(-78.99, Unit="degree")
jointPolarityRHFE = Simulink.Parameter(-1)
jointPolarityRKFE = Simulink.Parameter(-1)
zeroOffsetRKFE = Simulink.Parameter(-68.67, Unit="degree")
zeroOffsetRHFE = Simulink.Parameter(158.87, Unit="degree")
jointPolarityLKFE = Simulink.Parameter(1)
jointPolarityLHFE = Simulink.Parameter(-1)
maxTemperatureSomanet = Simulink.Parameter(85)
thresholdTempWarningSomanet = Simulink.Parameter(60)

motorTransmissionRatio = Simulink.Parameter(101)  % Motor turns/joint turn
  % probably never used

torquePolarityLHFE = Simulink.Parameter(-1)
torquePolarityLKFE = Simulink.Parameter(1)
torquePolarityRHFE = Simulink.Parameter(-1)
torquePolarityRKFE = Simulink.Parameter(-1)

IMUInfo = Simulink.Bus()
  angleX: double
  angleY: double
  angleZ: double

ExoskeletonData = Simulink.Bus()
  etherCATData: Bus: EtherCATData
  error: Bus: DeviceErrors
  masterInfo: Bus: MasterInfo
  miscDataSOMANETs: Bus: MiscDataSOMANET
  actualDynamics: Bus: JointDynamics[1 4]
  targetDynamics: Bus: JointDynamics[1 4]

EtherCATReceivedFromGES = Simulink.Bus()
  timestamp: double
  imuState: Enum: SensorState
  imuInfo: Bus: IMUInfo
  buttonState: Enum: SensorState
  buttonPressed: double
  motor1TempState: Enum: SensorState
  motor1Temp: double
  motor2TempState: Enum: SensorState
  motor2Temp: double

DeviceErrors = Simulink.Bus()
  errorSOMANETs: Enum: SomanetError[1 4]
  errorInputDevice: Enum: EthercatDeviceError
  errorGES: Enum: GESError[1 3]
  errorPDB: Enum: PDBError

EtherCATData = Simulink.Bus()
  receivedFromSOMANETs: Bus: EtherCATReceivedFromSOMANET[1 4]
  receivedFromInputDevice: Bus: EtherCATReceivedFromInputDevice
  receivedFromGESs: Bus: EtherCATReceivedFromGES[1 3]
  receivedFromPDB: Bus: EtherCATReceivedFromPDB
  sendToSOMANETs: Bus: EtherCATSendToSOMANET[1 4]
  sendToInputDevice: Bus: EtherCATSendToInputDevice
  sendToPDB: Bus: EtherCATSendToPDB

EtherCATReceivedFromPDB = Simulink.Bus()
  timestamp: double
  buttonPressedPDB: double
  errorMessagePDB: double
  statusTemperatureDCDC: double
  statusCurrentBattery: double
  statusVoltageBattery: double

EtherCATSendToPDB = Simulink.Bus()
  commandPDB: Enum: PDBCommand

powerButtonMinimumPressDuration = 2
shutdownDelay = Simulink.Parameter(0.5, Unit="second")

GESCommand = Simulink.Bus()
  buzzerCmd: uint8

modelFrequency = 500
waitTimeSitDown = 2
waitTimeStandUp = 3

ErrorInfo = Simulink.Bus()
  errorMessage: Enum: ErrorMessage
  errorLocation: Enum: ErrorLocation

MasterInfo = Simulink.Bus()
  errorMessage: Bus: ErrorInfo
  masterError: Enum: ExoskeletonError
  errorReaction: Enum: ErrorReaction
  masterState: Enum: ExoskeletonState
  stepType: Enum: StepType

EtherCATSendToInputDevice = Simulink.Bus()
  masterState: double
  errorMessage: double
  errorLocation: double

initializeStandUpHip = [92; 92.00001; 92.00004; 92.0001; 92.00018; 92.00028; 92.0004; 92.00054; 92.00071; 92.00089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 94.99999]
initializeStandUpKnee = repmat(90, 900, 1)
sitDownHip = [-2; -1.935971; -1.871859; -1.807664; -1.743385; -1.679024; -1.61458; -1.550054; -1.485445; -1.420753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 92.0000578125]
sitDownKnee = [2; 2.064008; 2.12806; 2.192153; 2.256289; 2.320467; 2.384688; 2.448951; 2.513255; 2.577602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 89.99866]
stairsDownLeftHip = [-2; -1.999675; -1.998702; -1.997083; -1.994822; -1.991922; -1.988385; -1.984214; -1.979413; -1.973983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 -1.997032]
stairsDownLeftKnee = [2; 2; 2; 2; 2; 2; 2; 2; 2; 2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 2.003093]
stairsDownRightHip = [-2; -1.999665; -1.99866; -1.996988; -1.99465; -1.991647; -1.987983; -1.983658; -1.978674; -1.973034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 -2.000026]
stairsDownRightKnee = [2; 2; 2; 2; 2; 2; 2; 2; 2; 2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 2]
stairsUpLeftHip = [-2; -2; -2; -2; -2; -2; -2; -2; -2; -2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 -1.997459]
stairsUpLeftKnee = [2; 2; 2; 2.000001; 2.000001; 2.000002; 2.000003; 2.000003; 2.000004; 2.000006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 2.005198]
stairsUpRightHip = [-2; -2; -1.999999; -1.999998; -1.999996; -1.999994; -1.999991; -1.999988; -1.999984; -1.999979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 -2]
stairsUpRightKnee = [2; 2; 2; 2; 2; 2; 2; 2; 2; 2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 2]
standUpHip = [95; 94.89993; 94.79977; 94.6995; 94.59913; 94.49867; 94.39811; 94.29745; 94.19669; 94.09583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 -1.914964]
standUpKnee = [90; 89.89997; 89.79991; 89.69984; 89.59973; 89.4996; 89.39945; 89.29927; 89.19907; 89.09884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 2.085009]
thresholdMotorTemperatureWarning = Simulink.Parameter([])
initializeSitDownHip = repmat(-2, 250, 1)
initializeSitDownKnee = repmat(2, 250, 1)
thresholdI2tSurfaceWarning = Simulink.Parameter(0.8)
currentNominal = Simulink.Parameter(15, Unit="ampere")
currentMaximum = Simulink.Parameter(35, Unit="ampere")
currentTimeMaximum = Simulink.Parameter(40, Unit="ampere")
maxPhasePeakCurrent = Simulink.Parameter(70, Unit="ampere")

JointControlConfigRHFE = struct(
  angleOffset=1245,
  polePairs=21,
  minPosLimit=-17.5,
  maxPosLimit=97.5,
  maxSpeed=60,
  maxTorque=3,
  positionKp=500000,
  positionKi=0,
  positionKd=0,
  positionIntegralLimit=2122,
  velocityKp=600000,
  velocityKi=10000,
  velocityKd=0,
  velocityIntegralLimit=2122,
  softStopThreshold=2.5)

JointControlConfigLHFE = struct(
  angleOffset=1245,
  polePairs=21,
  minPosLimit=-17.5,
  maxPosLimit=97.5,
  maxSpeed=60,
  maxTorque=3,
  positionKp=500000,
  positionKi=0,
  positionKd=0,
  positionIntegralLimit=2122,
  velocityKp=600000,
  velocityKi=10000,
  velocityKd=0,
  velocityIntegralLimit=2122,
  softStopThreshold=2.5)

maxPositionDifference = Simulink.Parameter(1, Unit="radian")

EtherCATReceivedFromInputDevice = Simulink.Bus()
  desiredState: double
  error: double
  heartbeat: double

enableGraphics = Simulink.Parameter(1)
stepSwingLegHip = [-12.99989; -12.99938; -12.99847; -12.99716; -12.99545; -12.99334; -12.99083; -12.98792; -12.98462; -12.98091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 25]
stepSwingLegKnee = [2; 2.000562; 2.002244; 2.005041; 2.008948; 2.013961; 2.020073; 2.027281; 2.035579; 2.044962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 11.99287]
stepStandLegHip = [24.9998; 24.99919; 24.99818; 24.99677; 24.99496; 24.99275; 24.99014; 24.98713; 24.98373; 24.97993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 -12.99999]
stepStandLegKnee = [11.88003; 11.76757; 11.65549; 11.54379; 11.43248; 11.32156; 11.21105; 11.10093; 10.99123; 10.88194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 2]
halfStepStandStartHip = [-1.914964; -1.914964; -1.914964; -1.914964; -1.914964; -1.914964; -1.914964; -1.914964; -1.914964; -1.914964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 -12.99999]
halfStepStandStartKnee = [2.085009; 2.085009; 2.085009; 2.085009; 2.085009; 2.085009; 2.085009; 2.085009; 2.085009; 2.085009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 2]
halfStepSwingStartHip = [-1.914964; -1.914964; -1.914964; -1.914964; -1.914964; -1.914964; -1.914964; -1.914964; -1.914964; -1.914964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 25]
halfStepSwingStartKnee = [2.085009; 2.085009; 2.085009; 2.085009; 2.085009; 2.085009; 2.085009; 2.085009; 2.085009; 2.085009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 11.99287]
halfStepStopFromSwingKnee = [11.88003; 11.76757; 11.65549; 11.54379; 11.43248; 11.32156; 11.21105; 11.10093; 10.99123; 10.88194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 2]
halfStepStopFromSwingHip = [24.9998; 24.99919; 24.99818; 24.99677; 24.99496; 24.99275; 24.99014; 24.98713; 24.98373; 24.97993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 -1.914964]
halfStepStopFromStandKnee = repmat(2.085009, 750, 1)
halfStepStopFromStandHip = [-12.99989; -12.99938; -12.99847; -12.99716; -12.99545; -12.99334; -12.99083; -12.98792; -12.98462; -12.98091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 -1.914964]

JointControlConfigLKFE = struct(
  angleOffset=1245,
  polePairs=21,
  minPosLimit=-2.5,
  maxPosLimit=112.5,
  maxSpeed=60,
  maxTorque=4.5,
  positionKp=500000,
  positionKi=0,
  positionKd=0,
  positionIntegralLimit=2122,
  velocityKp=600000,
  velocityKi=10000,
  velocityKd=0,
  velocityIntegralLimit=2122,
  softStopThreshold=2.5)

JointControlConfigRKFE = struct(
  angleOffset=1245,
  polePairs=21,
  minPosLimit=-2.5,
  maxPosLimit=112.5,
  maxSpeed=60,
  maxTorque=4.5,
  positionKp=500000,
  positionKi=0,
  positionKd=0,
  positionIntegralLimit=2122,
  velocityKp=600000,
  velocityKi=10000,
  velocityKd=0,
  velocityIntegralLimit=2122,
  softStopThreshold=2.5)